# Grasshopper definition example with envelope.gh (Grasshopper 1.0.7)
# plug-ins: Hops

pipeline = GeometryPipeline(
    GroupByLayer=False,
    GroupByType=False,
    IncludeHidden=True,
    IncludeLocked=True,
    LayerFilter="Road",
    NameFilter="*",
    SublayerFiltering=True,
    TypeFilter=4)
plot = Curve(<curve referenced from the Rhino model>)
hops = Hops(
    _Enabled=Toggle(True),
    Plot=plot,
    Streets=pipeline,
    CacheResultsInMemory=True,
    CacheSolveResults=True,
    RemoteDefinitionLocation="C:\OneDrive\OneDrive - REHUB digitale Planer GmbH\Documents\GIT\PA-23_1\hops_envelope.gh",
    RemoteSolveVersion=(0, 1, 0),
    ShowInput_Enabled=True,
    ShowInput_Path=False,
    SynchronousSolve=True)  # -> Envelope, Tx

# ----
# Example on how to make your buildings fit under the setbacks envelope
number_slider = Slider(14, range=0..15)
plot_2 = Curve(plot)
multiplication = Multiplication(A=number_slider, B=-1)
offset = OffsetCurve(Curve=plot_2, Distance=multiplication, Corners=1)
srf = Surface(offset)
popgeo = PopulateGeometry(Geometry=srf, Count=Slider(6, range=0..10), Seed=Slider(0, range=0..100))
number_slider_2 = Slider(12, range=0..100)
rectangle = Rectangle(Plane=popgeo, XSize=number_slider_2, YSize=number_slider_2, Radius=0)  # -> Rectangle, Length
graft = GraftTree(Tree=rectangle.Rectangle, IncludeEmptyLists=True, IncludeNullItems=True)
envelope_points = Point(hops.Envelope)
rectangles = Surface(graft)
incurve = PointInCurve(Point=envelope_points, Curve=graft)  # -> Relationship, Point
cull = CullPattern(List=envelope_points, CullPattern=incurve.Relationship)
pdecon = Deconstruct(Point=cull)  # -> XComponent, YComponent, ZComponent
sort = SortList(Keys=pdecon.ZComponent)  # -> Keys, ValuesA
avr = Average(Input=pdecon.ZComponent)
item = ListItem(List=sort.Keys, Index=0, Wrap=True)
panel = Panel(item)
Z = UnitZ(Factor=item)
extr = Extrude(Base=rectangles, Direction=Z)

pt = Point(hops.Envelope)
