# Grasshopper definition hops_envelope.gh (Grasshopper 1.0.7)

streets = GetGeometry(AtLeast=1, AtMost=1, DeleteInput=False, Filter=1074004029, TreeAccess=False)
plot = GetGeometry(AtLeast=1, AtMost=1, DeleteInput=False, Filter=1074004029, TreeAccess=False)
data = Data(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)

panel = Panel("Plot")
crv = Curve(plot)
graft = GraftTree(Tree=crv, IncludeEmptyLists=True, IncludeNullItems=True)

public_streets = Curve(streets)
trim = TrimWithRegion(Curve=public_streets, Region=graft)  # -> Inside, flatten(Outside)
explode = Explode(Curve=public_streets, Recursive=True)  # -> Segments, Vertices
crv_2 = Curve(trim.Outside)

# ---- group: Creating grid points
# Subdivide the plot into Grid Points
number_slider = Slider(60, range=0..100)
crv_3 = Curve(graft)
srf = Surface(crv_3)
divide = DivideDomain²(Domain=srf, UCount=number_slider, VCount=number_slider)
subsrf = Isotrim(Surface=srf, Domain=divide)
explode_2 = Explode(Curve=subsrf, Recursive=True)  # -> Segments, Vertices
flatten = FlattenTree(Tree=explode_2.Vertices, Path="{0}")
cullpt = CullDuplicates(Points=flatten, Tolerance=0.1, CullMode=1)  # -> Points, Indices, Valence
grid_points = Point(cullpt.Points)

# ---- group: filtering plot edges according to the streets
# Divide plot edges into those 1) next to public streets, and 2) private
# (check the presentation on Setbacks Envelope)
plot_2 = Curve(crv_3)
explode_3 = Explode(Curve=plot_2, Recursive=True)  # -> Segments, Vertices
public_streets_2 = Curve(crv_2)
panel_2 = Panel(explode_3.Segments)
graft_2 = GraftTree(Tree=explode_3.Segments, IncludeEmptyLists=True, IncludeNullItems=True)  # -> simplify(Tree)
pframes = PerpFrames(Curve=graft_2, Count=Slider(1, range=0..1), Align=True)  # -> Frames, Parameters
item = ListItem(List=pframes.Frames, Index=0, Wrap=True)
panel_3 = Panel(graft_2)
curvepoint = PointOnCurve(graft_2, parameter=0.5)
deplane = DeconstructPlane(Plane=item)  # -> Origin, XAxis, YAxis, ZAxis
crv_cp = CurveClosestPoint(Point=curvepoint, Curve=public_streets_2)  # -> Point, Parameter, Distance
sort = SortList(Keys=crv_cp.Distance, ValuesA=public_streets_2)  # -> Keys, ValuesA
line = LineSDL(Start=curvepoint, Direction=expr("-x", deplane.YAxis), Length=Slider(30, range=0..30))
item_2 = ListItem(List=sort.Keys, Index=0, Wrap=True)
item_3 = ListItem(List=sort.ValuesA, Index=0, Wrap=True)
ccx = CurveCurve(CurveA=item_3, CurveB=line)  # -> Points, ParamsA, ParamsB
dist = Distance(PointA=curvepoint, PointB=ccx.Points)
smaller = SmallerThan(FirstNumber=dist, SecondNumber=Slider(30, range=0..100))  # -> SmallerThan, OrEqualTo
panel_4 = Panel(smaller.SmallerThan)
null = NullItem(Item=smaller.SmallerThan)  # -> NullFlags, InvalidFlags, Description
not = GateNot(A=null.NullFlags)
panel_5 = Panel(not)
and = GateAnd(A=smaller.SmallerThan, B=not)
dispatch = Dispatch(List=graft_2, DispatchPattern=and)  # -> ListA, ListB
plot_edges_private = Curve(dispatch.ListB)

# ----
angle = Angle(VectorA=line, VectorB=item_3)  # -> Angle, Reflex
deg = Degrees(Radians=angle.Angle)
larger = LargerThan(FirstNumber=deg, SecondNumber=Slider(45, range=0..100))  # -> LargerThan, OrEqualTo
smaller_2 = SmallerThan(FirstNumber=deg, SecondNumber=Slider(130, range=0..1000))  # -> SmallerThan, OrEqualTo
and_2 = GateAnd(A=smaller_2.SmallerThan, B=larger.LargerThan)
and_3 = GateAnd(A=and, B=and_2)

# ---- group: filtering plot edges according to the streets (continued)
dispatch_2 = Dispatch(List=item_3, DispatchPattern=and_3)  # -> ListA, ListB
panel_6 = Panel(and_3)
streets_public = Curve(dispatch_2.ListA)

# ---- group: envelope
# Find smallest distance from each envelope point to one of plot edges.
# Bases on this distance, calculate max. possible building height.
# Get the envelope shape.
merge = Merge(Data1=plot_edges_private, Data2=streets_public)
grid_points_2 = Point(grid_points)
graft_3 = GraftTree(Tree=grid_points_2, IncludeEmptyLists=True, IncludeNullItems=True)  # -> simplify(Tree)
flatten_2 = FlattenTree(Tree=merge, Path="{0}")
panel_7 = Panel(graft_3)
crv_cp_2 = CurveClosestPoint(Point=graft_3, Curve=flatten_2)  # -> Point, Parameter, Distance
sort_2 = SortList(Keys=crv_cp_2.Distance)  # -> Keys, ValuesA
spacing_koef = Slider(0.5, range=0..1)
item_4 = ListItem(List=sort_2.Keys, Index=0, Wrap=True)
panel_8 = Panel(item_4)
division = Division(A=item_4, B=spacing_koef)
panel_9 = Panel(division)
Z = UnitZ(Factor=division)
move = Move(Geometry=graft_3, Motion=Z)  # -> Geometry, Transform
flatten_3 = FlattenTree(Tree=move.Geometry, Path="{0}")

# ----
lng = ListLength(List=flatten_3)
context_print = ContextPrint(Text=lng)
context_bake = ContextBake(Geometry=flatten_3)
