# Grasshopper definition hops_solitaries.gh (Grasshopper 1.0.7)

number_slider = Slider(9, range=0..100)  # disabled
number_slider_2 = Slider(163, range=0..360)  # disabled
pt = Point([Point(69.72547553, -90.7566798, 0), Point(1.19224416, 55.67057761, 0), Point(-29.23535407, -150.5701511, 0), Point(-3.574780367, -36.80005306, 0), Point(88.85167794, 16.02123946, 0), Point(55.65999155, -166.6318348, 0), Point(-9.182218229, -97.64182625, 0), Point(38.0594471, -3.499102613, 0), Point(76.53100123, -36.55482286, 0), Point(53.98092285, 56.77522758, 0)])  # disabled
width = GetNumber(number_slider, AtLeast=1, AtMost=1, Maximum=1.797693135e+308, Minimum=-1.797693135e+308, TreeAccess=False)
rotation = GetNumber(number_slider_2, AtLeast=1, AtMost=1, Maximum=1.797693135e+308, Minimum=-1.797693135e+308, TreeAccess=False)
get_point = GetPoint(pt, AtLeast=1, AtMost=1, Realtime=True, TreeAccess=False)
pt_2 = Point(get_point)
num = Number(width)
num_2 = Number(rotation)
rectangle = Rectangle(Plane=pt_2, XSize=num, YSize=num, Radius=0)  # -> Rectangle, Length
rotate = Rotate(Geometry=rectangle.Rectangle, Angle=degrees(num_2), Plane=pt_2)  # -> Geometry, Transform
srf = Surface(rotate.Geometry)
Z = UnitZ(Factor=num)
extr = Extrude(Base=srf, Direction=Z)
context_bake = ContextBake(Geometry=extr)
